# Dynamo graph HC GraphicProgram FilledRegion View Filters_script.dyn "HC GraphicProgram FilledRegion View Filters" (Dynamo 2.3.1.11775)
# packages: Data-Shapes 2022.2.99

# group: DOC - WIP
# note: ________________________________________________________
# note: USES: IN PROGRESS, FROZEN, BROKEN

# group: DOC - ANNOTATION
# note: ________________________________________________________
# note: USES: ANNOTATIONS, EXPLANATION

# group: DOC - WATCH
# note: ________________________________________________________
# note: USES: HIGHTLIGHT, WATCH

# group: WRITE DATA - STEP
# note: ________________________________________________________
# note: USES: TEMPORARY/SECONARY MODEL GEOM.

# group: LISTS + DATA
# note: ________________________________________________________
# note: USES: LIST, LIST MGMT, DATA

# group: WRITE DATA - FINAL
# note: ________________________________________________________
# note: USES: OUTPUTS, MODEL CHANGES

# group: LOGIC-AUXILLARY
# note: ________________________________________________________
# note: USES: LOGIC, DECISION MAKING, COMPUTATION

# group: LOGIC - PRIMARY
# note: ________________________________________________________
# note: USES: LOGIC, DECISION MAKING, COMPUTATION

# group: LOGIC-SECONDARY
# note: ________________________________________________________
# note: USES: LOGIC, DECISION MAKING, COMPUTATION

# group: INPUT - PARSE/MOD
# note: ________________________________________________________
# note: USES: TRANSLATING INPUTS FOR DYNAMO

# group: INPUT - FIXED
# note: ________________________________________________________
# note: USES: FIXED INPUTS, STATIC INPUTS

# group: INPUT - CONTROL
# note: ________________________________________________________
# note: USES: INPUT, UI INPUT, DATA IN

# group: Input UI
code_block = CodeBlock { "Filled Region View Filters"; "Create Filters"; "Cancel"; }
file_path = Filename(".\cogs logo.png")
file_from_path = FileObject(path=file_path)
readFromFile = Image.ReadFromFile(file=file_from_path)
code_block_2 = CodeBlock()
# ---------- code_block_2.designscript (12 lines) ----------
"Script Information:";
"Creates view filters for the current view to color code
filled regions based on values in the 'Comments' field.
Intended for use with the BAL-ARCH Graphic Progam tool.

Select the CSV file to assign RGB values per department name.
See example at NETWORK LOCATION TBD.

Note: Filters will only be created for departments already
assigned in to planning blocks in the model and also existing
in the CSV color file.  If additional departments are needed
later, re-run the script.";
# ----------------------------------------
# note: Custom Node: Data-Shapes v.2022.2.99
textnote_data = Custom[TextNote Data](Title=code_block_2.out0, TextNote=code_block_2.out1)  # package Data-Shapes; Create Data for TextNote input in UI.MultipleInputForm ++ . Check out www.data-shapes.net for more informations
code_block_3 = CodeBlock { "CSV File Path"; }
filepath_data = Custom[FilePath Data](InputName=code_block_3)  # package Data-Shapes; Create filepath input for UI.MultipleInputForm ++ . Check out www.data-shapes.net for more infos !
list_create = List.Create(item0=textnote_data, item1=filepath_data)
boolean = BoolSelector(true)
multipleinputform = Custom[MultipleInputForm ++](Description_optional=code_block.out0, Logo_optional=readFromFile, ButtonText_optional=code_block.out1, Inputs=list_create, Toggle=boolean, CancelButtonText_optional=code_block.out2)  # package Data-Shapes; Create a form with multiple inputs. see www.data-shapes.net for tutorials and infos!
watch = Watch(multipleinputform.Was_Run)
watch_2 = Watch(multipleinputform.Was_Cancelled)
not_ = Not(x=watch_2)
and_ = watch && not_
code_block_4 = CodeBlock(x=multipleinputform.User_Inputs) { csvFilePath = x[0]; }
watch_3 = Watch(code_block_4)

# group: wire cleanup
code_block_5 = CodeBlock(UI_RunNotCancelled=and_) { UI_RunNotCancelled; }
code_block_6 = CodeBlock(UI_RunNotCancelled=code_block_5) { UI_RunNotCancelled; }

# group: Get Active View
current = Document.Current()
activeView = Document.ActiveView(document=current)

# group: Input: Color legend CSV
importCSV = Data.ImportCSV(filePath=watch_3)

# group: Get Names from CSV, Create colors from RGBs
code_block_7 = CodeBlock { 1; }
dropItems = List.DropItems(list=importCSV@L2, amount=code_block_7)
code_block_8 = CodeBlock(x=dropItems) { names = x[0]; r = x[1]; g = x[2]; b = x[3]; }
code_block_9 = CodeBlock(names=code_block_8.names) { names; }
byARGB = Color.ByARGB(r=code_block_8.r, g=code_block_8.g, b=code_block_8.b)

# group: Get StackingDepartments Parameter
categories = Categories("OST_DetailComponents")
all_elements_of_category = ElementsOfCategory(Category=categories)
type = Object.Type(obj=all_elements_of_category)
code_block_10 = CodeBlock(x=type) { x == "Revit.Elements.FilledRegion"; }
filterByBoolMask = List.FilterByBoolMask(list=all_elements_of_category, mask=code_block_10)
code_block_11 = CodeBlock { "Comments"; }
getParameterValueByName = Element.GetParameterValueByName(element=filterByBoolMask.in, parameterName=code_block_11)
length = String.Length(str=getParameterValueByName)
code_block_12 = CodeBlock(x=length) { x>0; }
filterByBoolMask_2 = List.FilterByBoolMask(list=filterByBoolMask.in, mask=code_block_12)
firstItem = List.FirstItem(list=filterByBoolMask_2.in)
parameterByName = Parameter.ParameterByName(element=firstItem, name=code_block_11)

uniqueItems = List.UniqueItems(list=getParameterValueByName)
contains = List.Contains(list=uniqueItems, item=code_block_9@L1)
filterByBoolMask_3 = List.FilterByBoolMask(list=code_block_9, mask=contains)
watch_4 = Watch(filterByBoolMask_3.in)

# group: Create Filter Names
code_block_13 = CodeBlock(names=watch_4) { names; }
code_block_14 = CodeBlock { ":"; "-"; }
replace = String.Replace(str=code_block_13, searchFor=code_block_14.out0, replaceWith=code_block_14.out1)
code_block_15 = CodeBlock { 0; "HC PLANNING - "; }
insert = String.Insert(str=replace, index=code_block_15.out0, toInsert=code_block_15.out1)

filterByBoolMask_4 = List.FilterByBoolMask(list=byARGB, mask=contains)
watch_5 = Watch(filterByBoolMask_4.in)

# group: Match Existing and Proposed Filters
element_types = ElementTypes("FilterElement")
all_elements_of_type = ElementsOfType(element_type=element_types)
name = Element.Name(element=all_elements_of_type)
code_block_16 = CodeBlock(existingFilters=all_elements_of_type, existingFilterNames=name, filterNames=insert, deptNames=replace, colors=watch_5) { existingFilters; existingFilterNames; filterNames; deptNames; colors; }
python_script = Python(IN[0]=code_block_16.existingFilters, IN[1]=code_block_16.existingFilterNames, IN[2]=code_block_16.filterNames, IN[3]=code_block_16.deptNames, IN[4]=code_block_16.colors)
# ---------- python_script.python (32 lines) ----------
# Load the Python Standard and DesignScript Libraries

# The inputs to this node will be stored as a list in the IN variables.
existingFilters = IN[0]
existingFilterNames = IN[1]
filterNames = IN[2]
deptNames = IN[3]
colors = IN[4]

matchingFilters = []
matchingColors = []
unmatchedNames = []
unmatchedDepts = []
unmatchedColors = []

# Place your code below this line

for filterName, deptName, color in zip(filterNames, deptNames, colors):
	match = False
	for existingFilter, existingFilterName in zip(existingFilters, 	existingFilterNames):
		if filterName == existingFilterName:
			matchingFilters.append(existingFilter)
			matchingColors.append(color)
			match = True
			break
	if not match:
		unmatchedNames.append(filterName)
		unmatchedDepts.append(deptName)
		unmatchedColors.append(color)

# Assign your output to the OUT variable.
OUT = [matchingFilters, matchingColors, unmatchedNames, unmatchedDepts, unmatchedColors]
# ----------------------------------------
code_block_17 = CodeBlock(output=python_script)
# ---------- code_block_17.designscript (5 lines) ----------
matchingFilters = output[0];
matchingColors = output[1];
unmatchedNames = output[2];
unmatchedDepts = output[3];
unmatchedColors = output[4];
# ----------------------------------------
watch_6 = Watch(code_block_17.matchingFilters)
watch_7 = Watch(code_block_17.unmatchedNames)
watch_8 = Watch(code_block_17.unmatchedDepts)
watch_9 = Watch(code_block_17.matchingColors)
watch_10 = Watch(code_block_17.unmatchedColors)

# group: Logic gates for UI
code_block_18 = CodeBlock { null; }
if_ = If(test=code_block_6, true=activeView, false=code_block_18)
code_block_19 = CodeBlock { null; }
if_2 = If(test=code_block_6, true=watch_7, false=code_block_19)

# group: Create Filter Rule from 'SP-HC_Plan-Dept' parameter
select_rule_type = RuleTypes("Equals")
byRuleType = Revit.Filter.FilterRule.ByRuleType(type=select_rule_type, value=watch_8@L1, parameter=parameterByName, lacing=CrossProduct)

# group: Create Graphics Override settings
join = List.Join(list0=watch_9, list1=watch_10)
code_block_20 = CodeBlock(colors=join) { colors; }
fill_patterns = FillPatterns("<Solid fill>")
code_block_21 = CodeBlock { 1; }
byProperties = Revit.Filter.OverrideGraphicSettings.ByProperties(cutFillColor=code_block_20, projectionFillColor=code_block_20, cutFillPattern=fill_patterns, projectionFillPattern=fill_patterns, transparency=code_block_21)

# group: Add filters to Views
code_block_22 = CodeBlock(passthrough=if_2) { [passthrough]; }
categories_2 = Categories("OST_DetailComponents")
byRules = Revit.Filter.ParameterFilterElement.ByRules(name=code_block_22@L1, categories=categories_2, rules=byRuleType@L1)
join_2 = List.Join(list0=watch_6, list1=byRules)
boolean_2 = BoolSelector(true)
setFilterOverrides = View.SetFilterOverrides(view=if_@L1, parameterFilter=join_2, overrides=byProperties, hide=boolean_2)

# group: README / DYN INFO
code_block_23 = CodeBlock()
# ---------- code_block_23.designscript (22 lines) ----------
/*
BALLINGER DYNAMO SCRIPT INFO

Script: HC GraphicProgram FilledRegion View Filters.dyn
Author: D. Howard
Dynamo Version: 2.3.1
Date: 2022-08-04

Script inputs:

Script Functions & Outputs:

Dependencies:
	archi-lab
	Data-Shapes v2022

Dynamo Player Ready: Yes




*/;
# ----------------------------------------
